# Grasshopper definition 01.0.Shift.gh (Grasshopper 1.0.7)
# plug-ins: Bifocals, Noise 4D

gallery = ImageGallery(CycleDelay=30, Randomize=False, UseLocalImages=True, UseRemoteImages=False)
rev = ReverseList()
shift = ShiftList(Shift=1, Wrap=True)
ins = InsertItems(Wrap=True)
number_slider = Slider(2500, range=0..10000)
divide = DivideCurve(Count=10, Kinks=False)  # -> Points, Tangents, Parameters
bbox = BoundingBox(Plane=PlaneXY(0, 0, 0))  # -> Box, Box_2
loft = Loft(Options={Adjust=False, Closed=False, LoftEnds=0, LoftSimp=0, LoftType=0, Rebuild=10, Refit=0.01})
rectangle = Rectangle(Plane=PlaneXY(0, 0, 0), XSize=number_slider, YSize=number_slider, Radius=0)  # -> Rectangle, Length
move = Move(Motion=Vector(0, 0, 10))  # -> Geometry, Transform
rotate = Rotate(Angle=1.570796327, Plane=PlaneXY(0, 0, 0))  # -> Geometry, Transform
group = Group()
ungroup = Ungroup()
cir = Circle(Plane=PlaneXY(0, 0, 0), Radius=Slider(27.8, range=0..100))
Z = UnitZ(Factor=Slider(40.4, range=0..100))
area = Area(Geometry=rectangle.Rectangle)  # -> Area, Centroid
number_slider_2 = Slider(100, range=0..100)
number_slider_3 = Slider(4, range=0..10)
number_slider_4 = Slider(6, range=0..10)
move_2 = Move(Geometry=cir, Motion=Z)  # -> Geometry, Transform
number_slider_5 = Slider(20, range=12..20)
number_slider_6 = Slider(2.8, range=0..10)
scale = Scale(Geometry=rectangle.Rectangle, Center=area.Centroid, Factor=Slider(2.2, range=0..10))  # -> Geometry, Transform
pop2d = Populate2D(Region=rectangle.Rectangle, Count=Slider(34, range=0..100), Seed=1)
number_slider_7 = Slider(100, range=0..100)
rotate_2 = Rotate(Geometry=scale.Geometry, Angle=degrees(Slider(45, range=0..360)), Plane=area.Centroid)  # -> Geometry, Transform
rectangle_2 = Rectangle(Plane=PlaneXY(0, 0, 0), XSize=number_slider_2, YSize=number_slider_2, Radius=0)  # -> Rectangle, Length
divide_2 = DivideCurve(Curve=cir, Count=number_slider_5, Kinks=False)  # -> Points, Tangents, Parameters
divide_3 = DivideCurve(Curve=move_2.Geometry, Count=number_slider_5, Kinks=False)  # -> Points, Tangents, Parameters
rectangle_3 = Rectangle(Plane=PlaneXY(0, 0, 0), XSize=number_slider_7, YSize=number_slider_7, Radius=0)  # -> Rectangle, Length
trigrid = Triangular(Plane=PlaneXY(0, 0, 0), Size=Slider(100, range=0..100), ExtentX=number_slider_4, ExtentY=number_slider_4)  # -> Cells, Points
hexgrid = Hexagonal(Plane=PlaneXY(0, 0, 0), Size=Slider(100, range=0..100), ExtentX=number_slider_3, ExtentY=number_slider_3)  # -> Cells, Points

cp = ControlPoints(Curve=hexgrid.Cells)  # -> simplify(Points), Weights, Knots
tstat = TreeStatistics(Tree=cp.Points)  # -> Paths, Length, Count
item = ListItem(List=tstat.Length, Index=0, Wrap=True)
number_slider_8 = Slider(84.6, range=0..100)
number_slider_9 = Slider(100, range=0..100)
cull_i = CullIndex(List=cp.Points, Indices=expr("x-1", item), Wrap=True)
cullpt = CullDuplicates(Points=flatten(cp.Points), Tolerance=0.1, CullMode=3)  # -> Points, Indices, Valence
pdecon = Deconstruct(Point=cullpt.Points)  # -> XComponent, YComponent, ZComponent
simplex = SimplexNoise(Values=cullpt.Points, Time=Slider(42.5, range=0..100), Scale=number_slider_8)
simplex_2 = SimplexNoise(Values=cullpt.Points, Time=Slider(57.9, range=0..100), Scale=number_slider_8)
fsim = FindSimilarMember(Data=cull_i, Set=cullpt.Points)  # -> Hit, simplify(Index)
multiplication = Multiplication(A=simplex, B=number_slider_9)
multiplication_2 = Multiplication(A=simplex_2, B=number_slider_9)
addition = Addition(A=pdecon.XComponent, B=multiplication)
addition_2 = Addition(A=pdecon.YComponent, B=multiplication_2)
pt = ConstructPoint(XCoordinate=addition, YCoordinate=addition_2, ZCoordinate=pdecon.ZComponent)
item_2 = ListItem(List=pt, Index=fsim.Index, Wrap=True)
pline = PolyLine(Vertices=item_2, Closed=invert(False))

voronoi = Voronoi(Points=pop2d, Boundary=rotate_2.Geometry, BruteForceOverride=False)
points = PointList(Points=divide_2.Points, Size=number_slider_6)
explode = Explode(Curve=rectangle_2.Rectangle, Recursive=True)  # -> Segments, Vertices
item_3 = ListItem(List=explode.Segments, Index=0, Wrap=True)  # -> Item, Item1, Item2, Item3

number_slider_10 = Slider(0, range=0..40)
number_slider_11 = Slider(12, range=2..20)

shift_2 = ShiftList(List=divide_3.Points, Shift=Slider(6, range=0..10), Wrap=True)
points_2 = PointList(Points=shift_2, Size=number_slider_6)
explode_2 = Explode(Curve=pline, Recursive=True)  # -> Segments, Vertices
ln = Line(StartPoint=divide_2.Points, EndPoint=shift_2)
pt_2 = Point(Point(0.4430176501, -4.469898036, 32.94016986))
yz = YZPlane(Origin=pt_2)
shift_3 = ShiftList(List=explode_2.Segments, Shift=Slider(1, range=0..10), Wrap=True)
loft_opt = LoftOptions(Closed=Toggle(True), Adjust=False, Rebuild=0, Refit=0, Type=0)
vec = VectorXYZ(XComponent=Slider(1, range=0..1), YComponent=Slider(1, range=0..1), ZComponent=Slider(1, range=0..1))  # -> Vector, Length

divide_4 = DivideCurve(Curve=explode_2.Segments, Count=number_slider_11, Kinks=False)  # -> Points, Tangents, Parameters
divide_5 = DivideCurve(Curve=shift_3, Count=number_slider_11, Kinks=False)  # -> Points, Tangents, Parameters
shift_4 = ShiftList(List=divide_5.Points, Shift=number_slider_10, Wrap=True)
ln_2 = Line(StartPoint=divide_4.Points, EndPoint=shift_4)

divide_6 = DivideCurve(Curve=item_3.Item, Count=number_slider_11, Kinks=False)  # -> Points, Tangents, Parameters
divide_7 = DivideCurve(Curve=item_3.Item1, Count=number_slider_11, Kinks=False)  # -> Points, Tangents, Parameters
shift_5 = ShiftList(List=divide_7.Points, Shift=number_slider_10, Wrap=True)
ln_3 = Line(StartPoint=divide_6.Points, EndPoint=shift_5)

divide_8 = DivideCurve(Curve=item_3.Item1, Count=number_slider_11, Kinks=False)  # -> Points, Tangents, Parameters
divide_9 = DivideCurve(Curve=item_3.Item2, Count=number_slider_11, Kinks=False)  # -> Points, Tangents, Parameters
shift_6 = ShiftList(List=divide_9.Points, Shift=number_slider_10, Wrap=True)
ln_4 = Line(StartPoint=divide_8.Points, EndPoint=shift_6)

divide_10 = DivideCurve(Curve=item_3.Item2, Count=number_slider_11, Kinks=False)  # -> Points, Tangents, Parameters
divide_11 = DivideCurve(Curve=item_3.Item3, Count=number_slider_11, Kinks=False)  # -> Points, Tangents, Parameters
shift_7 = ShiftList(List=divide_11.Points, Shift=number_slider_10, Wrap=True)
ln_5 = Line(StartPoint=divide_10.Points, EndPoint=shift_7)

divide_12 = DivideCurve(Curve=item_3.Item3, Count=number_slider_11, Kinks=False)  # -> Points, Tangents, Parameters
divide_13 = DivideCurve(Curve=item_3.Item, Count=number_slider_11, Kinks=False)  # -> Points, Tangents, Parameters
shift_8 = ShiftList(List=divide_13.Points, Shift=number_slider_10, Wrap=True)
ln_6 = Line(StartPoint=divide_12.Points, EndPoint=shift_8)

loft_2 = Loft(Curves=ln, Options=loft_opt)
padjust = AdjustPlane(Plane=yz, Normal=vec.Vector)
panel = Panel(vec.Vector)
sec = BrepPlane(Brep=loft_2, Plane=padjust)  # -> Curves, Points
srfsplit = SurfaceSplit(Surface=loft_2, Curves=sec.Curves)
panel_2 = Panel(srfsplit)
item_4 = ListItem(List=srfsplit, Index=Slider(3, range=0..3), Wrap=True)
gallery_2 = ImageGallery(CycleDelay=30, Randomize=False, UseLocalImages=True, UseRemoteImages=False)
