# Grasshopper definition 02.1.Series.gh (Grasshopper 1.0.7)
# plug-ins: Bifocals, Noise 4D

bnd = Bounds()
dedomain = DeconstructDomain()  # -> Start, End
lng = ListLength()
# This definition is used for computer application course of TKU Archi EA3 and is licensed under Lee, Ching-Hang. You are free to copy, communicate and adapt the work, so long as you attribute the work in the manner specified by the author or licensor (but not in any way that suggests that they endorse you or your use of the work).
# 
# chinghanglee@hotmail.com
number_slider = Slider(0, range=0..10)
number_slider_2 = Slider(2.3, range=0..10)
cset = CreateSet()  # -> Set, Map
culln = CullNth(CullFrequency=2)
short = ShortestList(TrimMode=2)  # -> ListA, ListB
series = Series(Start=number_slider, Step=number_slider_2, Count=Slider(20, range=0..100))
panel = Panel(series)
rectangle = Rectangle(Plane=PlaneXY(0, 0, 0), XSize=Domain(-1, 1), YSize=Domain(-2, 2), Radius=0)  # -> Rectangle, Length
crv_cp = CurveClosestPoint()  # -> Point, Parameter, Distance
explode = Explode(Recursive=True)  # -> Segments, Vertices
pcen = PolygonCenter()  # -> CenterV, CenterE, CenterA
ext = ExtendCurve(Type=0)
number_slider_3 = Slider(2500, range=0..10000)
pt = ConstructPoint(XCoordinate=series, YCoordinate=0, ZCoordinate=0)
scale = Scale(Center=Point(0, 0, 0), Factor=0.5)  # -> Geometry, Transform
rotate = Rotate(Angle=1.570796327, Plane=PlaneXY(0, 0, 0))  # -> Geometry, Transform
rectangle_2 = Rectangle(Plane=pt, XSize=number_slider_2, YSize=number_slider_2, Radius=0)  # -> Rectangle, Length
rectangle_3 = Rectangle(Plane=PlaneXY(0, 0, 0), XSize=number_slider_3, YSize=number_slider_3, Radius=0)  # -> Rectangle, Length
boxrec = BoxRectangle(Rectangle=rectangle_2.Rectangle, Height=series)
area = Area(Geometry=rectangle_3.Rectangle)  # -> Area, Centroid
swatch = ColourSwatch(SwatchColor=RGB(255, 255, 255))
gradient = Gradient(LowerLimit=0, UpperLimit=1, stops=[0.15: RGB(255, 130, 160), 0.85: RGB(220, 0, 40)])
preview = CustomPreview(Shader={diffuse=RGB(255, 105, 180), emission=RGB(76, 32, 54), shine=0.5, specular=RGB(255, 255, 255), transparency=0})
number_slider_4 = Slider(4, range=0..10)
number_slider_5 = Slider(6, range=0..10)
number_slider_6 = Slider(40, range=0..100)
scale_2 = Scale(Geometry=rectangle_3.Rectangle, Center=area.Centroid, Factor=Slider(2.2, range=0..10))  # -> Geometry, Transform
pop2d = Populate2D(Region=rectangle_3.Rectangle, Count=Slider(34, range=0..100), Seed=1)
rotate_2 = Rotate(Geometry=scale_2.Geometry, Angle=degrees(Slider(45, range=0..360)), Plane=area.Centroid)  # -> Geometry, Transform
hexgrid = Hexagonal(Plane=PlaneXY(0, 0, 0), Size=Slider(100, range=0..100), ExtentX=number_slider_4, ExtentY=number_slider_4)  # -> simplify(Cells), Points

cp = ControlPoints(Curve=hexgrid.Cells)  # -> simplify(Points), Weights, Knots
tstat = TreeStatistics(Tree=cp.Points)  # -> Paths, Length, Count
item = ListItem(List=tstat.Length, Index=0, Wrap=True)
number_slider_7 = Slider(84.6, range=0..100)
number_slider_8 = Slider(100, range=0..100)
cull_i = CullIndex(List=cp.Points, Indices=expr("x-1", item), Wrap=True)
cullpt = CullDuplicates(Points=flatten(cp.Points), Tolerance=0.1, CullMode=3)  # -> Points, Indices, Valence
pdecon = Deconstruct(Point=cullpt.Points)  # -> XComponent, YComponent, ZComponent
simplex = SimplexNoise(Values=cullpt.Points, Time=Slider(42.5, range=0..100), Scale=number_slider_7)
simplex_2 = SimplexNoise(Values=cullpt.Points, Time=Slider(57.9, range=0..100), Scale=number_slider_7)
fsim = FindSimilarMember(Data=cull_i, Set=cullpt.Points)  # -> Hit, simplify(Index)
multiplication = Multiplication(A=simplex, B=number_slider_8)
multiplication_2 = Multiplication(A=simplex_2, B=number_slider_8)
addition = Addition(A=pdecon.XComponent, B=multiplication)
addition_2 = Addition(A=pdecon.YComponent, B=multiplication_2)
pt_2 = ConstructPoint(XCoordinate=addition, YCoordinate=addition_2, ZCoordinate=pdecon.ZComponent)
item_2 = ListItem(List=pt_2, Index=fsim.Index, Wrap=True)
pline = PolyLine(Vertices=item_2, Closed=invert(False))

rectangle_4 = Rectangle(Plane=PlaneXY(0, 0, 0), XSize=number_slider_6, YSize=number_slider_6, Radius=0)  # -> Rectangle, Length
trigrid = Triangular(Plane=PlaneXY(0, 0, 0), Size=Slider(100, range=0..100), ExtentX=number_slider_5, ExtentY=number_slider_5)  # -> Cells, Points
voronoi = Voronoi(Points=pop2d, Boundary=rotate_2.Geometry, BruteForceOverride=False)
number_slider_9 = Slider(30, range=0..100)
flatten = FlattenTree(Tree=hexgrid.Cells, Path="{0}")  # -> simplify(graft(Tree))
area_2 = Area(Geometry=flatten)  # -> Area, Centroid
series_2 = Series(Start="0.1", Step=Slider(0.04, range=0..1), Count=number_slider_9)
series_3 = Series(Start=0, Step=Slider(5.158, range=0..20), Count=number_slider_9)
scale_3 = Scale(Geometry=flatten, Center=area_2.Centroid, Factor=series_2)  # -> Geometry, Transform
rotate_3 = Rotate(Geometry=scale_3.Geometry, Angle=degrees(series_3), Plane=area_2.Centroid)  # -> Geometry, Transform
explode_2 = Explode(Curve=rotate_3.Geometry, Recursive=True)  # -> Segments, Vertices
cset_2 = CreateSet(List=explode_2.Vertices)  # -> simplify(Set), Map
pshift = ShiftPaths(Data=explode_2.Segments, Offset=-1)
pshift_2 = ShiftPaths(Data=cset_2.Set, Offset=-1)
number_slider_10 = Slider(-5, range=-5..10)
crv_cp_2 = CurveClosestPoint(Point=pshift_2, Curve=flatten)  # -> Point, Parameter, Distance
ext_2 = ExtendCurve(Curve=pshift, Type=0, Start=Slider(-10, range=-10..10), End=crv_cp_2.Distance)
lng_2 = ListLength(List=ext_2)
series_4 = Series(Start=0, Step=1, Count=lng_2)
gradient_2 = Gradient(
    LowerLimit=0,
    UpperLimit=expr("x-1", lng_2),
    Parameter=series_4,
    stops=[0: RGB(243, 57, 0), 0.1: RGB(236, 27, 60), 0.2: RGB(210, 0, 118), 0.3: RGB(103, 0, 120), 0.4: RGB(39, 72, 161), 0.5: RGB(1, 192, 229), 0.653: RGB(18, 178, 90), 0.743: RGB(79, 186, 8), 0.849: RGB(220, 237, 32), 1: RGB(247, 159, 20)])
preview_2 = CustomPreview(Geometry=ext_2, Material=gradient_2)
