# Grasshopper definition 03.cullPattern.gh (Grasshopper 1.0.7)
# plug-ins: Bifocals

# This definition is used for computer application course of TKU Archi EA3 and is licensed under Lee, Ching-Hang. You are free to copy, communicate and adapt the work, so long as you attribute the work in the manner specified by the author or licensor (but not in any way that suggests that they endorse you or your use of the work).
# 
# chinghanglee@hotmail.com
series = Series(Start=0, Step=1, Count=10)
number_slider = Slider(3.2, range=0..10)
crossref = CrossReference(ListA=series, ListB=series, CrossMode=1)  # -> ListA, ListB
pt = ConstructPoint(XCoordinate=crossref.ListA, YCoordinate=crossref.ListB, ZCoordinate=0)
item = ListItem(List=pt, Index=Slider(44, range=0..100), Wrap=True)
cir = Circle(Plane=item, Radius=number_slider)
dist = Distance(PointA=pt, PointB=item)
smaller = SmallerThan(FirstNumber=dist, SecondNumber=number_slider)  # -> SmallerThan, OrEqualTo
number_slider_2 = Slider(0.3, range=0..10)
dispatch = Dispatch(List=pt, DispatchPattern=smaller.SmallerThan)  # -> ListA, ListB
polygon = Polygon(Plane=dispatch.ListA, Radius=number_slider_2, Segments="3", FilletRadius=0)  # -> Polygon, Length
polygon_2 = Polygon(Plane=dispatch.ListB, Radius=number_slider_2, Segments="6", FilletRadius=0)  # -> Polygon, Length
boundary = BoundarySurfaces(Edges=polygon.Polygon)
boundary_2 = BoundarySurfaces(Edges=polygon_2.Polygon)
preview = CustomPreview(Geometry=boundary, Material=ColourSwatch(SwatchColor=RGB(255, 0, 0)))
preview_2 = CustomPreview(Geometry=boundary_2, Material=ColourSwatch(SwatchColor=RGB(0, 17, 255)))
