# Grasshopper definition 04.siftPatternList.gh (Grasshopper 1.0.7)
# plug-ins: Bifocals

number_slider = Slider(12, range=0..100)
# This definition is used for computer application course of TKU Archi EA3 and is licensed under Lee, Ching-Hang. You are free to copy, communicate and adapt the work, so long as you attribute the work in the manner specified by the author or licensor (but not in any way that suggests that they endorse you or your use of the work).
# 
# chinghanglee@hotmail.com
sqgrid = Square(Plane=PlaneXY(0, 0, 0), Size=1, ExtentX=5, ExtentY=5)  # -> Cells, Points
sqgrid_2 = Square(Plane=PlaneXY(0, 0, 0), Size=Slider(5, range=0..10), ExtentX=number_slider, ExtentY=number_slider)  # -> Cells, simplify(Points)
panel = Panel("""1
1
1
0
0""")
flip = FlipMatrix()
dispatch = Dispatch(List=sqgrid_2.Points, DispatchPattern=panel)  # -> ListA, ListB
not = GateNot()
flip_2 = FlipMatrix(Data=dispatch.ListB)
flip_3 = FlipMatrix(Data=dispatch.ListA)
panel_2 = Panel("""1
1
1
0
0""")
combine = CombineData()  # -> Result, Index
sift = SiftPattern(SiftPattern=[0, 0, 1, 1])  # -> Output0, Output1
dispatch_2 = Dispatch(List=flip_2, DispatchPattern=invert(panel_2))  # -> ListA, ListB
dispatch_3 = Dispatch(List=flip_3, DispatchPattern=panel_2)  # -> ListA, ListB
number_slider_2 = Slider(1.6, range=0..6)
merge = Merge(Data1=dispatch_3.ListA, Data2=dispatch_2.ListA)
merge_2 = Merge(Data1=dispatch_3.ListB, Data2=dispatch_2.ListB)
polygon = Polygon(Plane=merge, Radius=number_slider_2, Segments=6, FilletRadius=0)  # -> Polygon, Length
polygon_2 = Polygon(Plane=merge_2, Radius=number_slider_2, Segments=6, FilletRadius=0)  # -> Polygon, Length
boundary = BoundarySurfaces(Edges=polygon.Polygon)
boundary_2 = BoundarySurfaces(Edges=polygon_2.Polygon)
preview = CustomPreview(
    Geometry=boundary,
    Shader={diffuse=RGB(255, 105, 180), emission=RGB(76, 32, 54), shine=0.5, specular=RGB(255, 255, 255), transparency=0})
preview_2 = CustomPreview(Geometry=boundary_2, Shader=ColourSwatch(SwatchColor=RGB(0, 72, 255)))
sqgrid_3 = Square(Plane=PlaneXY(0, 0, 0), Size=1, ExtentX=Slider(10, range=0..10), ExtentY=Slider(10, range=0..10))  # -> Cells, simplify(Points)
# Try Different Pattern!
panel_3 = Panel("""1
1
0""")
dispatch_4 = Dispatch(List=sqgrid_3.Points, DispatchPattern=[True, False])  # -> ListA, ListB
sift_2 = SiftPattern(List=sqgrid_3.Points, SiftPattern=panel_3)  # -> Output0, Output1
flip_4 = FlipMatrix(Data=dispatch_4.ListA)
flip_5 = FlipMatrix(Data=dispatch_4.ListB)
flip_6 = FlipMatrix(Data=sift_2.Output1)
flip_7 = FlipMatrix(Data=sift_2.Output0)
not_2 = GateNot(A=panel_3)
dispatch_5 = Dispatch(List=flip_5, DispatchPattern=invert([True, False]))  # -> ListA, ListB
dispatch_6 = Dispatch(List=flip_4, DispatchPattern=[True, False])  # -> ListA, ListB
sift_3 = SiftPattern(List=flip_6, SiftPattern=not_2)  # -> Output0, Output1
sift_4 = SiftPattern(List=flip_7, SiftPattern=panel_3)  # -> Output0, Output1
number_slider_3 = Slider(0.5, range=0..1)
merge_3 = Merge(Data1=dispatch_6.ListA, Data2=dispatch_5.ListA)
merge_4 = Merge(Data1=dispatch_6.ListB, Data2=dispatch_5.ListB)
combine_2 = CombineData(Input0=sift_4.Output0, Input1=sift_3.Output0)  # -> Result, Index
combine_3 = CombineData(Input0=sift_4.Output1, Input1=sift_3.Output1)  # -> Result, Index
polygon_3 = Polygon(Plane=merge_3, Radius=number_slider_3, Segments=6, FilletRadius=0)  # -> Polygon, Length
polygon_4 = Polygon(Plane=merge_4, Radius=number_slider_3, Segments=6, FilletRadius=0)  # -> Polygon, Length
polygon_5 = Polygon(Plane=combine_2.Result, Radius=number_slider_3, Segments=6, FilletRadius=0)  # -> Polygon, Length
polygon_6 = Polygon(Plane=combine_3.Result, Radius=number_slider_3, Segments=6, FilletRadius=0)  # -> Polygon, Length
boundary_3 = BoundarySurfaces(Edges=polygon_3.Polygon)
boundary_4 = BoundarySurfaces(Edges=polygon_4.Polygon)
boundary_5 = BoundarySurfaces(Edges=polygon_5.Polygon)
boundary_6 = BoundarySurfaces(Edges=polygon_6.Polygon)
preview_3 = CustomPreview(
    Geometry=boundary_3,
    Shader={diffuse=RGB(255, 105, 180), emission=RGB(76, 32, 54), shine=0.5, specular=RGB(255, 255, 255), transparency=0})
preview_4 = CustomPreview(Geometry=boundary_4, Shader=ColourSwatch(SwatchColor=RGB(255, 255, 255)))
preview_5 = CustomPreview(
    Geometry=boundary_5,
    Shader={diffuse=RGB(255, 105, 180), emission=RGB(76, 32, 54), shine=0.5, specular=RGB(255, 255, 255), transparency=0})
preview_6 = CustomPreview(Geometry=boundary_6, Shader=ColourSwatch(SwatchColor=RGB(255, 255, 255)))
