# Grasshopper definition 05.Random.gh (Grasshopper 1.0.7)
# plug-ins: MeshEdit Components, Bifocals, Weaverbird

number_slider = Slider(20, range=0..100)

# ---- group: NumsOfTowns
numersoftown = Slider(3.6, range=0..10)
recgrid = Rectangular(
    Plane=PlaneXY(0, 0, 0),
    SizeX=Slider(10, range=0..10),
    SizeY=Slider(10, range=0..10),
    ExtentX=Slider(8, range=0..10),
    ExtentY=Slider(6, range=0..10))  # -> Cells, flatten(Points)
points = PointList(Points=recgrid.Points, Size=numersoftown)

# ----
number_slider_2 = Slider(20, range=0..100)
# This definition is used for computer application course of TKU Archi EA3 and is licensed under Lee, Ching-Hang. You are free to copy, communicate and adapt the work, so long as you attribute the work in the manner specified by the author or licensor (but not in any way that suggests that they endorse you or your use of the work).
# 
# chinghanglee@hotmail.com
panel = Panel("100")

# ---- group: NumsOfBlocks
sqgrid = Square(Plane=recgrid.Points, Size=Slider(2, range=0..10), ExtentX=Slider(3, range=0..10), ExtentY=Slider(3, range=0..10))  # -> simplify(Cells), Points

# ----
random = Random(Range=panel, Number=number_slider_2, Seed=Slider(37, range=0..100))
random_2 = Random(Range=panel, Number=number_slider_2, Seed=2)
random_3 = Random(Range=panel, Number=number_slider_2, Seed=Slider(35, range=0..100))
random_4 = Random(Range=panel, Number=number_slider_2, Seed=2)
rectangle = Rectangle(Plane=PlaneXY(0, 0, 0), XSize=number_slider, YSize=number_slider, Radius=0)  # -> Rectangle, Length
explode = Explode(Curve=rectangle.Rectangle, Recursive=True)  # -> Segments, Vertices
dom = ConstructDomain(DomainStart=Slider(0, range=0..100), DomainEnd=Slider(100, range=0..100))
divide = DivideCurve(Curve=explode.Segments, Count=10, Kinks=False)  # -> Points, Tangents, Parameters
pt = ConstructPoint(XCoordinate=random_2, YCoordinate=0, ZCoordinate=0)
pt_2 = ConstructPoint(XCoordinate=random_3, YCoordinate=panel, ZCoordinate=0)
pt_3 = ConstructPoint(XCoordinate=0, YCoordinate=random_4, ZCoordinate=0)
pt_4 = ConstructPoint(XCoordinate=panel, YCoordinate=random, ZCoordinate=0)
panel_2 = Panel("""10
5
22
99""")
random_5 = Random(Range=dom, Number="4", Seed=Slider(39, range=0..100))
jitter = Jitter(List=divide.Points, Jitter=1, Seed=graft(random_5))  # -> Values, Indices
ln = Line(StartPoint=pt, EndPoint=pt_2)
ln_2 = Line(StartPoint=pt_3, EndPoint=pt_4)
pshift = ShiftPaths(Data=sqgrid.Cells, Offset=-1)
flip = FlipMatrix(Data=jitter.Values)
tstat = TreeStatistics(Tree=pshift)  # -> Paths, Length, Count

# ---- group: Level
dom_2 = ConstructDomain(DomainStart=Slider(3, range=0..10), DomainEnd=Slider(9, range=0..10))

# ----
item = ListItem(List=flip, Index=0, Wrap=True)  # -> Item, Item1, Item2, Item3
cset = CreateSet(List=tstat.Length)  # -> Set, Map
genes = GenePool(Decimals=2, Maximum=100, Minimum=0, Value=[1.113642147, 50.11030652, 62.59471321, 79.01513128])

# ---- group: randomSeed
panel_3 = Panel("10000")
random_6 = Random(Range=panel_3, Number=tstat.Count, Seed=2)  # -> graft(Random)

# ----
subtraction = Subtraction(A=cset.Set, B=1)
ln_3 = Line(StartPoint=item.Item, EndPoint=item.Item2)
ln_4 = Line(StartPoint=item.Item1, EndPoint=item.Item3)
random_7 = Random(Range=subtraction, Number=tstat.Count, Seed=2, Integers=True)  # -> graft(Random)
random_8 = Random(Range="100", Number=Slider(20, range=0..100), Seed=genes)  # -> simplify(Random)
random_9 = Random(Range=dom_2, Number=simplify(graft(tstat.Length)), Seed=simplify(random_6), Integers=True)  # -> simplify(Random)
bang = ExplodeTree(Data=random_8)  # -> Branch0, Branch1, Branch2, Branch3
reduce = RandomReduce(List=pshift, Reduction=random_7, Seed=random_6)
tstat_2 = TreeStatistics(Tree=reduce)  # -> Paths, Length, Count
pt_5 = ConstructPoint(XCoordinate=bang.Branch0, YCoordinate=0, ZCoordinate=0)
pt_6 = ConstructPoint(XCoordinate=bang.Branch1, YCoordinate="100", ZCoordinate=0)
pt_7 = ConstructPoint(XCoordinate=0, YCoordinate=bang.Branch2, ZCoordinate=0)
pt_8 = ConstructPoint(XCoordinate="100", YCoordinate=bang.Branch3, ZCoordinate=0)
boxrec = BoxRectangle(Rectangle=pshift, Height=random_9)
random_10 = Random(Range=panel_3, Number=tstat_2.Count, Seed=2)  # -> graft(Random)
ln_5 = Line(StartPoint=pt_5, EndPoint=pt_6)
ln_6 = Line(StartPoint=pt_7, EndPoint=pt_8)
random_11 = Random(Range=dom_2, Number=simplify(graft(tstat_2.Length)), Seed=simplify(random_10), Integers=True)  # -> simplify(Random)
boxrec_2 = BoxRectangle(Rectangle=reduce, Height=random_11)
clean = CleanTree(RemoveNulls=True, RemoveInvalid=True, RemoveEmpty=invert(False), Tree=boxrec_2)
number_slider_3 = Slider(10, range=0..100)
sunion = SolidUnion(Breps=clean)  # disabled
tstat_3 = TreeStatistics(Tree=sunion)  # -> Paths, Length, Count
random_12 = Random(Range=number_slider_3, Number=tstat_3.Count, Seed=2, Integers=True)
pop3d = Populate3D(Region=sunion, Count=number_slider_3, Seed=graft(random_10))
random_13 = Random(Range=number_slider_3, Number=random_12, Seed=random_12, Integers=True)  # -> simplify(Random)
pshift_2 = ShiftPaths(Data=pop3d, Offset=-1)
cset_2 = CreateSet(List=random_13)  # -> Set, Map
item_2 = ListItem(List=pshift_2, Index=cset_2.Set, Wrap=True)
cull_i = CullIndex(List=pshift_2, Indices=cset_2.Set, Wrap=True)
shift = ShiftList(List=item_2, Shift=1, Wrap=True)
merge = Merge(Data1=cull_i, Data2=shift)
vcell = VoronoiCell(Point=simplify(item_2), Neighbours=simplify(merge))
mjoin = MeshJoin(Meshes=vcell)  # disabled
number_slider_4 = Slider(2, range=0..10)  # disabled
weldvertices = MeshWeldVertices(Mesh=mjoin, Tolerance=0.01)  # -> RuntimeMessage, Mesh; disabled
wbcatmullclark = WeaverbirdsCatmullClarkSubdivision(MeshCurves=weldvertices.Mesh, Level=number_slider_4, SmoothNakedEdges=2)  # disabled
