# Grasshopper definition parametricDome.gh (Grasshopper 1.0.7)
# plug-ins: Pufferfish, PTComponentLibrary, Bifocals, Bowerbird

sph = Sphere(Base=PlaneXY(0, 0, 0), Radius=Slider(50, range=0..1000))
debrep = DeconstructBrep(Brep=sph)  # -> Faces, Edges, Vertices
shatter = Shatter(Curve=reparameterize(debrep.Edges), Parameters="0.5")
item = ListItem(List=shatter, Index=0, Wrap=True)  # -> Item, Item1
fline = FitLine(Points=debrep.Vertices)
revsrf = Revolution(Curve=item.Item1, Axis=fline, Domain=Domain(0, 6.283185307))
number_slider = Slider(8, range=0..10)
srf = Surface(revsrf)
divide = DivideDomain²(Domain=srf, UCount=Slider(11, range=0..15), VCount=number_slider)
sbox = SurfaceBox(Surface=srf, Domain=divide, Height=Slider(10, range=0..10))
partition = PartitionList(List=sbox, Size=number_slider)  # -> simplify(Chunks)
item_2 = ListItem(List=partition, Index=expr("x-1", number_slider), Wrap=True)
cull_i = CullIndex(List=partition, Indices=expr("x-1", number_slider), Wrap=True)
crv = Curve(<curve referenced from the Rhino model>)
geo = Geometry(<brep referenced from the Rhino model>)
geo_2 = Geometry(<brep referenced from the Rhino model>)
geo_3 = Geometry(<brep referenced from the Rhino model>)
geo_4 = Geometry(<brep referenced from the Rhino model>)
panel = Panel("""1
0""")
sift = SiftPattern(List=cull_i, SiftPattern=panel)  # -> Output0, Output1
popgeo = PopulateGeometry(Geometry=srf, Count=Slider(7, range=0..10), Seed=1)
project = Project(Curve=crv, Brep=srf, Direction=Vector(0, 0, 1))
geo_5 = Geometry(<brep referenced from the Rhino model>)
geo_6 = Geometry(<brep referenced from the Rhino model>)
geo_7 = Geometry(<brep referenced from the Rhino model>)
geo_8 = Geometry(<brep referenced from the Rhino model>)
flip = FlipMatrix(Data=sift.Output1)
not = GateNot(A=panel)
join = BrepJoin(Breps=item_2)  # -> Breps, Closed
flip_2 = FlipMatrix(Data=sift.Output0)
debrep_2 = DeconstructBrep(Brep=cull_i)  # -> Faces, Edges, Vertices
mesh = MeshBrep(
    Brep=geo_5,
    Settings={GridMaxCount=0, GridMinCount=16, JaggedSeams=False, MaxEdgeLength=0, MinEdgeLength=0.0001, MinTolerance=0, Refine=True, RefineAngle=0, RelativeTolerance=0.65, SimplePlanes=True, Tolerance=0})
mesh_2 = MeshBrep(
    Brep=geo_6,
    Settings={GridMaxCount=0, GridMinCount=16, JaggedSeams=False, MaxEdgeLength=0, MinEdgeLength=0.0001, MinTolerance=0, Refine=True, RefineAngle=0, RelativeTolerance=0.65, SimplePlanes=True, Tolerance=0})
mesh_3 = MeshBrep(
    Brep=geo_7,
    Settings={GridMaxCount=0, GridMinCount=16, JaggedSeams=False, MaxEdgeLength=0, MinEdgeLength=0.0001, MinTolerance=0, Refine=True, RefineAngle=0, RelativeTolerance=0.65, SimplePlanes=True, Tolerance=0})
mesh_4 = MeshBrep(
    Brep=geo_8,
    Settings={GridMaxCount=0, GridMinCount=16, JaggedSeams=False, MaxEdgeLength=0, MinEdgeLength=0.0001, MinTolerance=0, Refine=True, RefineAngle=0, RelativeTolerance=0.65, SimplePlanes=True, Tolerance=0})
sift_2 = SiftPattern(List=flip_2, SiftPattern=panel)  # -> Output0, Output1
sift_3 = SiftPattern(List=flip, SiftPattern=not)  # -> Output0, Output1
avr = Average(Input=debrep_2.Vertices)
mesh_5 = MeshBrep(
    Brep=join.Breps,
    Settings={GridMaxCount=0, GridMinCount=16, JaggedSeams=False, MaxEdgeLength=0, MinEdgeLength=0.0001, MinTolerance=0, Refine=True, RefineAngle=0, RelativeTolerance=0.65, SimplePlanes=True, Tolerance=0})
demesh = DeconstructMesh(Mesh=mesh)  # -> Vertices, Faces, Colours, Normals
demesh_2 = DeconstructMesh(Mesh=mesh_2)  # -> Vertices, Faces, Colours, Normals
demesh_3 = DeconstructMesh(Mesh=mesh_3)  # -> Vertices, Faces, Colours, Normals
demesh_4 = DeconstructMesh(Mesh=mesh_4)  # -> Vertices, Faces, Colours, Normals
pull = PullPoint(Point=flatten(avr), Geometry=project, ClosestOnly=True)  # -> ClosestPoint, Distance
combine = CombineData(Input0=sift_2.Output0, Input1=sift_3.Output0)  # -> Result, Index

geo1 = Geometry(geo_3)
mesh_6 = MeshBrep(
    Brep=geo1,
    Settings={GridMaxCount=0, GridMinCount=16, JaggedSeams=False, MaxEdgeLength=0, MinEdgeLength=0.0001, MinTolerance=0, Refine=True, RefineAngle=0, RelativeTolerance=0.65, SimplePlanes=True, Tolerance=0})
bbox = BoundingBox(Content=geo1, Plane=PlaneXY(0, 0, 0))  # -> Box, Box_2
morph = BoxMorph(Geometry=mesh_6, Reference=bbox.Box, Target=combine.Result)

combine_2 = CombineData(Input0=sift_2.Output1, Input1=sift_3.Output1)  # -> Result, Index

geo2 = Geometry(geo_4)
mesh_7 = MeshBrep(
    Brep=geo2,
    Settings={GridMaxCount=0, GridMinCount=16, JaggedSeams=False, MaxEdgeLength=0, MinEdgeLength=0.0001, MinTolerance=0, Refine=True, RefineAngle=0, RelativeTolerance=0.65, SimplePlanes=True, Tolerance=0})
bbox_2 = BoundingBox(Content=geo2, Plane=PlaneXY(0, 0, 0))  # -> Box, Box_2
morph_2 = BoxMorph(Geometry=mesh_7, Reference=bbox_2.Box, Target=combine_2.Result)

dom = ConstructDomain(DomainStart=0, DomainEnd="3")
bnd = Bounds(Numbers=pull.Distance)
conmesh = ConstructMesh(Vertices=demesh.Vertices, Faces=demesh.Faces, Colours=ColourSwatch(SwatchColor=RGB(255, 0, 255)))
conmesh_2 = ConstructMesh(Vertices=demesh_2.Vertices, Faces=demesh_2.Faces, Colours=ColourSwatch(SwatchColor=RGB(0, 255, 255)))
conmesh_3 = ConstructMesh(Vertices=demesh_3.Vertices, Faces=demesh_3.Faces, Colours=ColourSwatch(SwatchColor=RGB(0, 0, 255)))
conmesh_4 = ConstructMesh(Vertices=demesh_4.Vertices, Faces=demesh_4.Faces, Colours=ColourSwatch(SwatchColor=RGB(255, 255, 0)))
remap = RemapNumbers(Value=pull.Distance, Source=bnd, Target=dom)  # -> Mapped, Clipped
round = Round(Number=remap.Mapped)  # -> Nearest, Floor, Ceiling
bbox_3 = BoundingBox(Content=mesh, Plane=PlaneXY(0, 0, 0))  # -> Box, Box_2
bbox_4 = BoundingBox(Content=mesh_2, Plane=PlaneXY(0, 0, 0))  # -> Box, Box_2
bbox_5 = BoundingBox(Content=mesh_3, Plane=PlaneXY(0, 0, 0))  # -> Box, Box_2
bbox_6 = BoundingBox(Content=mesh_4, Plane=PlaneXY(0, 0, 0), UnionBox=True)  # -> Box, Box_2
mjoin = MeshJoin(Meshes=flatten([morph, morph_2, mesh_5]))
graph = GraphMapper(
    round.Nearest,
    x0=0,
    x1=3,
    y0=0,
    y1=3,
    container_name="Bezier",
    cpx=[0, 0, 0.4450128675, 1],
    cpy=[0, 1, 0.05370873213, 0.8572038412])
morph_3 = BoxMorph(Geometry=conmesh, Reference=bbox_3.Box, Target=cull_i)
morph_4 = BoxMorph(Geometry=conmesh_3, Reference=bbox_5.Box, Target=cull_i)
morph_5 = BoxMorph(Geometry=conmesh_4, Reference=bbox_6.Box, Target=cull_i)
morph_6 = BoxMorph(Geometry=conmesh_2, Reference=bbox_4.Box, Target=cull_i)
p_n_c = PickNChoose(Pattern=graph, Stream0=flatten(morph_3), Stream1=flatten(morph_6), Stream2=flatten(morph_4), Stream3=flatten(morph_5))
crv_2 = Curve([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])
pt = Point(Point(-700, -7, 0))

# ---- group: DomeCreation
sph_2 = Sphere(Base=pt, Radius=Slider(300, range=0..1000))
debrep_3 = DeconstructBrep(Brep=sph_2)  # -> Faces, Edges, Vertices
shatter_2 = Shatter(Curve=reparameterize(debrep_3.Edges), Parameters="0.5")
fline_2 = FitLine(Points=debrep_3.Vertices)
item_3 = ListItem(List=shatter_2, Index=0, Wrap=True)  # -> Item, Item1
revsrf_2 = Revolution(Curve=item_3.Item1, Axis=fline_2, Domain=Domain(0, 6.283185307))

# ---- group: SurfaceSubdivision
number_slider_2 = Slider(6, range=0..10)
srf_2 = Surface(revsrf_2)
divide_2 = DivideDomain²(Domain=srf_2, UCount=Slider(14, range=0..20), VCount=number_slider_2)
sbox_2 = SurfaceBox(Surface=srf_2, Domain=divide_2, Height=Slider(30, range=0..100))
partition_2 = PartitionList(List=sbox_2, Size=number_slider_2)

# ----
S = Surface(srf_2)
number_slider_3 = Slider(10, range=10..30)
number_slider_4 = Slider(16, range=10..30)
item_4 = ListItem(List=partition_2, Index="-1", Wrap=True)  # -> flatten(Item)
offset = OffsetSurface(Surface=S, Distance=Slider(28.2, range=0..100), Retrim=True)
cull_i_2 = CullIndex(List=partition_2, Indices="-1", Wrap=True)
sunion = SolidUnion(Breps=item_4)
ptsrfdomnum = SurfaceDomainNumber(Surface=S, UNumber=number_slider_4, VNumber=number_slider_3)  # -> simplify(Grid)
ptsrfdomnum_2 = SurfaceDomainNumber(Surface=offset, UNumber=number_slider_4, VNumber=number_slider_3)

panel_2 = Panel("{0,2,4...}[0,2,4...]")  # disabled
panel_3 = Panel("{!(0,2,4...)}[!(0,2,4...)]")  # disabled
split = SplitTree(Data=simplify(cull_i_2), Masks=flatten(panel_2))  # -> Positive, Negative; disabled
split_2 = SplitTree(Data=simplify(split.Negative), Masks=flatten(panel_3))  # -> Positive, Negative; disabled
clean = CleanTree(RemoveNulls=True, RemoveInvalid=True, RemoveEmpty=False, Tree=split.Positive)  # disabled
clean_2 = CleanTree(RemoveNulls=True, RemoveInvalid=True, RemoveEmpty=False, Tree=split_2.Positive)  # disabled
clean_3 = CleanTree(RemoveNulls=True, RemoveInvalid=True, RemoveEmpty=False, Tree=split_2.Negative)  # disabled
merge = Merge(Data1=clean, Data2=clean_2)  # disabled

panel_4 = Panel("""1
0""")
sift_4 = SiftPattern(List=cull_i_2, SiftPattern=panel_4)  # -> Output0, Output1
not_2 = GateNot(A=panel_4)
flip_3 = FlipMatrix(Data=sift_4.Output0)
flip_4 = FlipMatrix(Data=sift_4.Output1)
sift_5 = SiftPattern(List=flip_3, SiftPattern=panel_4)  # -> Output0, Output1
sift_6 = SiftPattern(List=flip_4, SiftPattern=not_2)  # -> Output0, Output1
combine_3 = CombineData(Input0=sift_5.Output1, Input1=sift_6.Output1)  # -> Result, Index
combine_4 = CombineData(Input0=sift_5.Output0, Input1=sift_6.Output0)  # -> Result, Index

panel_5 = Panel("""1
0""")
flip_5 = FlipMatrix(Data=ptsrfdomnum)
flip_6 = FlipMatrix(Data=ptsrfdomnum_2)

geo2_2 = Geometry(<brep referenced from the Rhino model>)
geo1_2 = Geometry(<brep referenced from the Rhino model>)
volume = Volume(Geometry=geo2_2)  # -> Volume, Centroid
yz = YZPlane(Origin=volume.Centroid)
xz = XZPlane(Origin=volume.Centroid)
planesrf = PlaneSurface(Plane=xz, XSize=Domain(-10, 10), YSize=Domain(-10, 10))
planesrf_2 = PlaneSurface(Plane=yz, XSize=Domain(-10, 10), YSize=Domain(-10, 10))
split_3 = SplitBrep(Brep=geo2_2, Cutter=planesrf)
item_5 = ListItem(List=split_3, Index=0, Wrap=True)  # -> Item, Item1
split_4 = SplitBrep(Brep=item_5.Item, Cutter=planesrf_2)
item_6 = ListItem(List=split_4, Index=0, Wrap=True)  # -> Item, Item1

ptwrap = WrapGrids(Grid=flip_6, Dir="0", Steps="1", Index="1")  # -> simplify(Grid)
ptwrap_2 = WrapGrids(Grid=flip_5, Dir="0", Steps="1", Index="1")  # -> simplify(Grid)
not_3 = GateNot(A=panel_5)
pttodiamond = ConvertToDiamond(Grid=ptwrap_2)
pttodiamond_2 = ConvertToDiamond(Grid=ptwrap)
pt3dcell = Cellulate3DGrid(Grid1=pttodiamond, Grid2=pttodiamond_2)  # -> Wires, simplify(Cells), Boxes
item_7 = ListItem(List=pt3dcell.Cells, Index=0, Wrap=True)  # -> Item, Item1, Item2, Item3, Item4, Item5, Item6, Item7
tbox = TwistedBox(
    CornerA=item_7.Item,
    CornerB=item_7.Item1,
    CornerC=item_7.Item2,
    CornerD=item_7.Item3,
    CornerE=item_7.Item4,
    CornerF=item_7.Item5,
    CornerG=item_7.Item6,
    CornerH=item_7.Item7)
pshift = ShiftPaths(Data=tbox, Offset=-1)
sift_7 = SiftPattern(List=pshift, SiftPattern=panel_5)  # -> Output0, Output1
flip_7 = FlipMatrix(Data=sift_7.Output0)
flip_8 = FlipMatrix(Data=sift_7.Output1)
sift_8 = SiftPattern(List=flip_7, SiftPattern=panel_5)  # -> Output0, Output1
sift_9 = SiftPattern(List=flip_8, SiftPattern=not_3)  # -> Output0, Output1
combine_5 = CombineData(Input0=sift_8.Output1, Input1=sift_9.Output1)  # -> Result, Index
combine_6 = CombineData(Input0=sift_8.Output0, Input1=sift_9.Output0)  # -> Result, Index
geo_9 = Geometry(<brep referenced from the Rhino model>)
geo_10 = Geometry(<brep referenced from the Rhino model>)
tstat = TreeStatistics(Tree=combine_6.Result)  # -> Paths, Length, Count
cotbox = ConstructTwistedBox(Corners=pt3dcell.Cells)  # -> flatten(TwistedBox)
panel_6 = Panel("""1
0""")
popgeo_2 = PopulateGeometry(Geometry=S, Count=Slider(5, range=0..10), Seed=1)

# ---- group: Tessellation
geo2_3 = Geometry(geo_10)
geo1_3 = Geometry(geo_9)
bbox_7 = BoundingBox(Content=geo2_3, Plane=PlaneXY(0, 0, 0))  # -> Box, Box_2
bbox_8 = BoundingBox(Content=geo1_3, Plane=PlaneXY(0, 0, 0))  # -> Box, Box_2
morph_7 = BoxMorph(Geometry=geo1_3, Reference=bbox_8.Box, Target=combine_4.Result)
morph_8 = BoxMorph(Geometry=geo2_3, Reference=bbox_7.Box, Target=combine_3.Result)

# ----
cull = CullPattern(List=tstat.Paths, CullPattern=[False, True])
tboxcents = TwistedBoxCenters(TwistedBox=cotbox, CenterType=0)
branch = TreeBranch(Tree=combine_6.Result, Path=cull, MaintainPaths=True)
srf_cp = SurfaceClosestPoint(Point=popgeo_2, Surface=reparameterize(S))  # -> Point, UVPoint, Distance
srf_cp_2 = SurfaceClosestPoint(Point=tboxcents, Surface=reparameterize(S))  # -> Point, UVPoint, Distance
qsph = QuadSphere(Base=srf_cp.Point, Radius=1)
morph_9 = BoxMorph(Geometry=geo2_3, Reference=bbox_7.Box, Target=combine_5.Result)
morph_10 = BoxMorph(Geometry=geo1_3, Reference=bbox_8.Box, Target=combine_6.Result)
i = Index(0)
curvature = PrincipalCurvature(Surface=reparameterize(S), Point=srf_cp_2.UVPoint)  # -> Frame, Min, Max, MinDirection, MaxDirection; disabled
curvature_2 = SurfaceCurvature(Surface=reparameterize(S), Point=srf_cp_2.UVPoint)  # -> Frame, Gaussian, Mean
pull_2 = PullPoint(Point=tboxcents, Geometry=srf_cp.Point, ClosestOnly=True)  # -> ClosestPoint, Distance

# ---- group: initialBox
weave = Weave(Pattern=[0, 1], Stream0=combine_4.Result, Stream1=combine_3.Result, NullGaps=False)  # -> simplify(Weave)

# ----
eval = Evaluate(F="(x-(x%2))/2", x=number_slider_4)
weave_2 = Weave(Pattern=[0, 1], Stream0=morph_7, Stream1=morph_8, NullGaps=False)  # -> simplify(Weave)
weave_3 = Weave(Pattern=[0, 1], Stream0=morph_10, Stream1=morph_9, NullGaps=False)  # -> simplify(Weave); disabled
item_8 = ListItem(List=reverse(pt3dcell.Boxes), Index=i, Wrap=True)
series = Series(Start="1", Step=1, Count=eval)
bnd_2 = Bounds(Numbers=flatten(pull_2.Distance))
clean_4 = CleanTree(RemoveNulls=True, RemoveInvalid=True, RemoveEmpty=invert(False), Tree=weave)
number_slider_5 = Slider(0, range=0..20)
clean_5 = CleanTree(RemoveNulls=True, RemoveInvalid=True, RemoveEmpty=invert(False), Tree=weave_2)
dom_2 = ConstructDomain(DomainStart=0, DomainEnd="4")
unim = UnifyMesh(Mesh=weave_3)  # -> Result, Count; disabled
branch_2 = TreeBranch(Tree=simplify(item_8), Path=series, MaintainPaths=True)
flip_9 = FlipMatrix(Data=clean_4)  # -> simplify(Data)
remap_2 = RemapNumbers(Value=pull_2.Distance, Source=bnd_2, Target=dom_2)  # -> Mapped, Clipped
flip_10 = FlipMatrix(Data=clean_5)
number_slider_6 = Slider(14, range=0..20)
graph_2 = GraphMapper(remap_2.Mapped, x0=0, x1=4, y0=0, y1=4, container_name="Bezier", cpx=[0, 0.8998280168, 0, 1], cpy=[0, 0, 1, 1])
bbtext = BBText(Bold=False, HorizontalAlignment=0, VerticalAlignment=0)
branch_3 = TreeBranch(Tree=flip_9, Path=number_slider_5, MaintainPaths=True)
branch_4 = TreeBranch(Tree=flip_10, Path=number_slider_5, MaintainPaths=True)
item_9 = ListItem(List=flatten(branch_3), Index=number_slider_6, Wrap=True)
round_2 = Round(Number=graph_2)  # -> Nearest, Floor, flatten(Ceiling)
panel_7 = Panel(round_2.Ceiling)
item_10 = ListItem(List=flatten(branch_4), Index=number_slider_6, Wrap=True)
debrep_4 = DeconstructBrep(Brep=item_9)  # -> Faces, Edges, Vertices
mesh_8 = Mesh(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)
mesh_9 = Mesh(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)
mesh_10 = Mesh(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)
mesh_11 = Mesh(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)
mesh_12 = Mesh(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)
swatch = ColourSwatch(SwatchColor=RGB(255, 0, 0))
item_11 = ListItem(List=debrep_4.Faces, Index=0, Wrap=True)  # -> Item1, Item
demesh_5 = DeconstructMesh(Mesh=mesh_12)  # -> Vertices, Faces, Colours, Normals
demesh_6 = DeconstructMesh(Mesh=mesh_8)  # -> Vertices, Faces, Colours, Normals
demesh_7 = DeconstructMesh(Mesh=mesh_10)  # -> Vertices, Faces, Colours, Normals
demesh_8 = DeconstructMesh(Mesh=mesh_9)  # -> Vertices, Faces, Colours, Normals
demesh_9 = DeconstructMesh(Mesh=mesh_11)  # -> Vertices, Faces, Colours, Normals
bbox_9 = BoundingBox(Content=mesh_11, Plane=PlaneXY(0, 0, 0), UnionBox=True)  # -> Box, Box_2
area = Area(Geometry=item_11.Item1)  # -> Area, Centroid
swatch_2 = ColourSwatch(SwatchColor=RGB(138, 138, 138))
debrep_5 = DeconstructBrep(Brep=item_11.Item1)  # -> Faces, Edges, Vertices
evalsrf = EvaluateSurface(Surface=reparameterize(item_11.Item1), Point=area.Centroid)  # -> Point, Normal, UDirection, VDirection, Frame
conmesh_5 = ConstructMesh(Vertices=demesh_5.Vertices, Faces=demesh_5.Faces, Colours=ColourSwatch(SwatchColor=RGB(255, 0, 0)))
conmesh_6 = ConstructMesh(Vertices=demesh_6.Vertices, Faces=demesh_6.Faces, Colours=ColourSwatch(SwatchColor=RGB(255, 255, 0)))
item_12 = ListItem(List=debrep_5.Edges, Index=0, Wrap=True)  # -> Item, Item1
conmesh_7 = ConstructMesh(Vertices=demesh_7.Vertices, Faces=demesh_7.Faces, Colours=ColourSwatch(SwatchColor=RGB(0, 0, 255)))
bbox_10 = BoundingBox(Content=mesh_12, Plane=PlaneXY(0, 0, 0), UnionBox=True)  # -> Box, Box_2
bbox_11 = BoundingBox(Content=mesh_8, Plane=PlaneXY(0, 0, 0), UnionBox=True)  # -> Box, Box_2
bbox_12 = BoundingBox(Content=mesh_9, Plane=PlaneXY(0, 0, 0), UnionBox=True)  # -> Box, Box_2
bbox_13 = BoundingBox(Content=mesh_10, Plane=PlaneXY(0, 0, 0), UnionBox=True)  # -> Box, Box_2
conmesh_8 = ConstructMesh(Vertices=demesh_8.Vertices, Faces=demesh_8.Faces, Colours=ColourSwatch(SwatchColor=RGB(0, 255, 0)))
conmesh_9 = ConstructMesh(Vertices=demesh_9.Vertices, Faces=demesh_9.Faces, Colours=ColourSwatch(SwatchColor=RGB(138, 138, 138)))
pl = PlaneNormal(Origin=area.Centroid, ZAxis=evalsrf.Normal)
morph_11 = BoxMorph(Geometry=conmesh_6, Reference=bbox_11.Box, Target=cotbox)
morph_12 = BoxMorph(Geometry=conmesh_8, Reference=bbox_12.Box, Target=cotbox)
morph_13 = BoxMorph(Geometry=conmesh_7, Reference=bbox_13.Box, Target=cotbox)
morph_14 = BoxMorph(Geometry=conmesh_9, Reference=bbox_9.Box, Target=cotbox)
morph_15 = BoxMorph(Geometry=conmesh_5, Reference=bbox_10.Box, Target=cotbox)
align = AlignPlane(Plane=pl, Direction=item_12.Item1)  # -> Plane, Angle
orient = Orient(Geometry=item_10, Source=align.Plane, Target=PlaneXY(0, 0, 0))  # -> Geometry, Transform
p_n_c_2 = PickNChoose(
    Pattern=flatten(round_2.Ceiling),
    Stream0=flatten(morph_15),
    Stream1=flatten(morph_11),
    Stream2=flatten(morph_12),
    Stream3=flatten(morph_13),
    Stream4=flatten(morph_14))
unim_2 = UnifyMesh(Mesh=p_n_c_2)  # -> Result, Count
