# Grasshopper definition parametricDomeBasic.gh (Grasshopper 1.0.7)
# plug-ins: Bifocals

sph = Sphere(Base=PlaneXY(0, 0, 0), Radius="150")
debrep = DeconstructBrep(Brep=sph)  # -> Faces, Edges, Vertices
shatter = Shatter(Curve=reparameterize(debrep.Edges), Parameters="0.5")
item = ListItem(List=shatter, Index=0, Wrap=True)  # -> Item, Item1
fline = FitLine(Points=debrep.Vertices)
revsrf = Revolution(Curve=item.Item1, Axis=fline, Domain=Domain(0, 6.283185307))
number_slider = Slider(8, range=0..10)
srf = Surface(revsrf)
divide = DivideDomain²(Domain=srf, UCount=Slider(11, range=0..15), VCount=number_slider)
sbox = SurfaceBox(Surface=srf, Domain=divide, Height=Slider(10, range=0..10))
crv = Curve(<curve referenced from the Rhino model>)
partition = PartitionList(List=sbox, Size=number_slider)  # -> simplify(Chunks)
cull_i = CullIndex(List=partition, Indices=expr("x-1", number_slider), Wrap=True)
debrep_2 = DeconstructBrep(Brep=cull_i)  # -> Faces, Edges, Vertices
project = Project(Curve=crv, Brep=revsrf, Direction=Vector(0, 0, 1))
panel = Panel("""1
0""")
geo = Geometry(<brep referenced from the Rhino model>)
geo_2 = Geometry(<brep referenced from the Rhino model>)
geo_3 = Geometry(<brep referenced from the Rhino model>)
geo_4 = Geometry(<brep referenced from the Rhino model>)
avr = Average(Input=debrep_2.Vertices)
item_2 = ListItem(List=partition, Index=expr("x-1", number_slider), Wrap=True)
sift = SiftPattern(List=cull_i, SiftPattern=panel)  # -> Output0, Output1
pull = PullPoint(Point=flatten(avr), Geometry=project, ClosestOnly=True)  # -> ClosestPoint, Distance
flip = FlipMatrix(Data=sift.Output1)
not = GateNot(A=panel)
flip_2 = FlipMatrix(Data=sift.Output0)

# ---- group: convert to 0 -1 for GraphMapper
bnd = Bounds(Numbers=pull.Distance)
remap = RemapNumbers(Value=pull.Distance, Source=bnd, Target=Domain(0, 1))  # -> Mapped, Clipped

# ----
sift_2 = SiftPattern(List=flip_2, SiftPattern=panel)  # -> Output0, Output1
sift_3 = SiftPattern(List=flip, SiftPattern=not)  # -> Output0, Output1
join = BrepJoin(Breps=item_2)  # -> Breps, Closed

module5 = Geometry(<brep referenced from the Rhino model>)
mesh = MeshBrep(
    Brep=module5,
    Settings={GridMaxCount=0, GridMinCount=16, JaggedSeams=False, MaxEdgeLength=0, MinEdgeLength=0.0001, MinTolerance=0, Refine=True, RefineAngle=0, RelativeTolerance=0.65, SimplePlanes=True, Tolerance=0})
bbox = BoundingBox(Content=module5, Plane=PlaneXY(0, 0, 0))  # -> Box, Box_2
demesh = DeconstructMesh(Mesh=mesh)  # -> Vertices, Faces, Colours, Normals
conmesh = ConstructMesh(Vertices=demesh.Vertices, Faces=demesh.Faces, Colours=ColourSwatch(SwatchColor=RGB(0, 255, 156)))
morph = BoxMorph(Geometry=conmesh, Reference=bbox.Box, Target=cull_i)

module3 = Geometry(<brep referenced from the Rhino model>)
mesh_2 = MeshBrep(
    Brep=module3,
    Settings={GridMaxCount=0, GridMinCount=16, JaggedSeams=False, MaxEdgeLength=0, MinEdgeLength=0.0001, MinTolerance=0, Refine=True, RefineAngle=0, RelativeTolerance=0.65, SimplePlanes=True, Tolerance=0})
bbox_2 = BoundingBox(Content=module3, Plane=PlaneXY(0, 0, 0))  # -> Box, Box_2
demesh_2 = DeconstructMesh(Mesh=mesh_2)  # -> Vertices, Faces, Colours, Normals
conmesh_2 = ConstructMesh(Vertices=demesh_2.Vertices, Faces=demesh_2.Faces, Colours=ColourSwatch(SwatchColor=RGB(0, 0, 255)))
morph_2 = BoxMorph(Geometry=conmesh_2, Reference=bbox_2.Box, Target=cull_i)

module4 = Geometry(<brep referenced from the Rhino model>)
mesh_3 = MeshBrep(
    Brep=module4,
    Settings={GridMaxCount=0, GridMinCount=16, JaggedSeams=False, MaxEdgeLength=0, MinEdgeLength=0.0001, MinTolerance=0, Refine=True, RefineAngle=0, RelativeTolerance=0.65, SimplePlanes=True, Tolerance=0})
bbox_3 = BoundingBox(Content=module4, Plane=PlaneXY(0, 0, 0))  # -> Box, Box_2
demesh_3 = DeconstructMesh(Mesh=mesh_3)  # -> Vertices, Faces, Colours, Normals
conmesh_3 = ConstructMesh(Vertices=demesh_3.Vertices, Faces=demesh_3.Faces, Colours=ColourSwatch(SwatchColor=RGB(255, 0, 0)))
morph_3 = BoxMorph(Geometry=conmesh_3, Reference=bbox_3.Box, Target=cull_i)

module1 = Geometry(<brep referenced from the Rhino model>)
mesh_4 = MeshBrep(
    Brep=module1,
    Settings={GridMaxCount=0, GridMinCount=16, JaggedSeams=False, MaxEdgeLength=0, MinEdgeLength=0.0001, MinTolerance=0, Refine=True, RefineAngle=0, RelativeTolerance=0.65, SimplePlanes=True, Tolerance=0})
bbox_4 = BoundingBox(Content=module1, Plane=PlaneXY(0, 0, 0))  # -> Box, Box_2
demesh_4 = DeconstructMesh(Mesh=mesh_4)  # -> Vertices, Faces, Colours, Normals
conmesh_4 = ConstructMesh(Vertices=demesh_4.Vertices, Faces=demesh_4.Faces, Colours=ColourSwatch(SwatchColor=RGB(255, 0, 255)))
morph_4 = BoxMorph(Geometry=conmesh_4, Reference=bbox_4.Box, Target=cull_i)

module2 = Geometry(<brep referenced from the Rhino model>)
mesh_5 = MeshBrep(
    Brep=module2,
    Settings={GridMaxCount=0, GridMinCount=16, JaggedSeams=False, MaxEdgeLength=0, MinEdgeLength=0.0001, MinTolerance=0, Refine=True, RefineAngle=0, RelativeTolerance=0.65, SimplePlanes=True, Tolerance=0})
bbox_5 = BoundingBox(Content=module2, Plane=PlaneXY(0, 0, 0))  # -> Box, Box_2
demesh_5 = DeconstructMesh(Mesh=mesh_5)  # -> Vertices, Faces, Colours, Normals
conmesh_5 = ConstructMesh(Vertices=demesh_5.Vertices, Faces=demesh_5.Faces, Colours=ColourSwatch(SwatchColor=RGB(0, 255, 255)))
morph_5 = BoxMorph(Geometry=conmesh_5, Reference=bbox_5.Box, Target=cull_i)

mesh_6 = MeshBrep(
    Brep=join.Breps,
    Settings={GridMaxCount=0, GridMinCount=16, JaggedSeams=False, MaxEdgeLength=0, MinEdgeLength=0.0001, MinTolerance=0, Refine=True, RefineAngle=0, RelativeTolerance=0.65, SimplePlanes=True, Tolerance=0})
combine = CombineData(Input0=sift_2.Output0, Input1=sift_3.Output0)  # -> Result, Index
combine_2 = CombineData(Input0=sift_2.Output1, Input1=sift_3.Output1)  # -> Result, Index
graph = GraphMapper(
    remap.Mapped,
    x0=0,
    x1=1,
    y0=0,
    y1=1,
    container_name="Sine",
    Equation_px=[0, 0.3365337253],
    Equation_py=[0, 0.9156011939])

geo1 = Geometry(geo_3)
mesh_7 = MeshBrep(
    Brep=geo1,
    Settings={GridMaxCount=0, GridMinCount=16, JaggedSeams=False, MaxEdgeLength=0, MinEdgeLength=0.0001, MinTolerance=0, Refine=True, RefineAngle=0, RelativeTolerance=0.65, SimplePlanes=True, Tolerance=0})
bbox_6 = BoundingBox(Content=geo1, Plane=PlaneXY(0, 0, 0))  # -> Box, Box_2
demesh_6 = DeconstructMesh(Mesh=mesh_7)  # -> Vertices, Faces, Colours, Normals
conmesh_6 = ConstructMesh(Vertices=demesh_6.Vertices, Faces=demesh_6.Faces, Colours=ColourSwatch(SwatchColor=RGB(255, 165, 255)))
morph_6 = BoxMorph(Geometry=conmesh_6, Reference=bbox_6.Box, Target=combine.Result)

# ---- group: convert to 0-4 for PickNchoose
dom = ConstructDomain(DomainStart=0, DomainEnd="4")
remap_2 = RemapNumbers(Value=graph, Source=Domain(0, 1), Target=dom)  # -> Mapped, Clipped

# ----
round = Round(Number=remap_2.Mapped)  # -> Nearest, Floor, Ceiling
p_n_c = PickNChoose(
    Pattern=round.Nearest,
    Stream0=flatten(morph_4),
    Stream1=flatten(morph_5),
    Stream2=flatten(morph_2),
    Stream3=flatten(morph_3),
    Stream4=flatten(morph))
panel_2 = Panel("""0
0
0
0
0""")
panel_3 = Panel("""a
b
c
d
e""")
panel_4 = Panel("""!
@
#
$
%""")
panel_5 = Panel("""我
不
愛
蚱
蜢""")
mjoin = MeshJoin(Meshes=p_n_c)
unim = UnifyMesh(Mesh=mjoin)  # -> Result, Count
p_n_c_2 = PickNChoose(Pattern=panel_2, Stream0=panel_3, Stream1=panel_4, Stream2=panel_5)
panel_6 = Panel(p_n_c_2)

geo2 = Geometry(geo_4)
mesh_8 = MeshBrep(
    Brep=geo2,
    Settings={GridMaxCount=0, GridMinCount=16, JaggedSeams=False, MaxEdgeLength=0, MinEdgeLength=0.0001, MinTolerance=0, Refine=True, RefineAngle=0, RelativeTolerance=0.65, SimplePlanes=True, Tolerance=0})
bbox_7 = BoundingBox(Content=geo2, Plane=PlaneXY(0, 0, 0))  # -> Box, Box_2

demesh_7 = DeconstructMesh(Mesh=mesh_8)  # -> Vertices, Faces, Colours, Normals
conmesh_7 = ConstructMesh(Vertices=demesh_7.Vertices, Faces=demesh_7.Faces, Colours=ColourSwatch(SwatchColor=RGB(165, 255, 255)))

morph_7 = BoxMorph(Geometry=conmesh_7, Reference=bbox_7.Box, Target=combine_2.Result)

mjoin_2 = MeshJoin(Meshes=flatten([morph_6, morph_7, mesh_6]))
