# Grasshopper definition parametricTowerBasic.gh (Grasshopper 1.0.7)

number_slider = Slider(28, range=1..30)
polygon = Polygon(Plane=PlaneXY(0, 0, 0), Radius=Slider(20, range=0..100), Segments=Slider(5, range=3..8), FilletRadius=0)  # -> Polygon, Length
series = Series(Start=0, Step=Slider(4.6, range=0..10), Count=number_slider)
Z = UnitZ(Factor=series)
move = Move(Geometry=polygon.Polygon, Motion=Z)  # -> Geometry, Transform
pcen = PolygonCenter(Polyline=move.Geometry)  # -> CenterV, CenterE, CenterA
pline = PolyLine(Vertices=pcen.CenterV, Closed=False)

divide = DivideCurve(Curve=reparameterize(pline), Count=expr("x-1", number_slider), Kinks=False)  # -> Points, Tangents, Parameters
graph = GraphMapper(
    divide.Parameters,
    x0=0,
    x1=1,
    y0=0,
    y1=1,
    container_name="Sine Summation",
    Equation0_px=[0.1017754301, 0.3034598529],
    Equation0_py=[0, 0.5033431053],
    Equation1_px=[0.2681815326, 1],
    Equation1_py=[0.28125, 0.6931624413])
series_2 = Series(Start=0, Step=Slider(10, range=0..10), Count=number_slider)
multiplication = Multiplication(A=graph, B=series_2)

item = ListItem(List=pcen.CenterV, Index=0, Wrap=True)
Z_2 = UnitZ(Factor=1)
line = LineSDL(Start=item, Direction=Z_2, Length=1)
rotax = RotateAxis(Geometry=move.Geometry, Angle=degrees(multiplication), Axis=line)  # -> Geometry, Transform
graph_2 = GraphMapper(
    divide.Parameters,
    x0=0,
    x1=1,
    y0=0,
    y1=1,
    container_name="Bezier",
    cpx=[0, 0.5505648255, 0.7166567445, 1],
    cpy=[0.7999378443, 0.5270690918, 0.01099467278, 0.6338445544])
scale = Scale(Geometry=rotax.Geometry, Center=pcen.CenterV, Factor=graph_2)  # -> Geometry, Transform
loft = Loft(Curves=scale.Geometry, Options={Adjust=False, Closed=False, LoftEnds=0, LoftSimp=0, LoftType=0, Rebuild=10, Refit=0.01})
cap = CapHoles(Brep=loft)
mesh = MeshBrep(
    Brep=cap,
    Settings={GridMaxCount=0, GridMinCount=16, JaggedSeams=False, MaxEdgeLength=0, MinEdgeLength=0.0001, MinTolerance=0, Refine=True, RefineAngle=0, RelativeTolerance=0.65, SimplePlanes=True, Tolerance=0})
