# Grasshopper definition parametricDomeBasic.gh (Grasshopper 1.0.7)

sph = Sphere(Base=PlaneXY(0, 0, 0), Radius=1)
debrep = DeconstructBrep(Brep=sph)  # -> Faces, Edges, Vertices
shatter = Shatter(Curve=reparameterize(debrep.Edges), Parameters="0.5")
item = ListItem(List=shatter, Index=0, Wrap=True)  # -> Item, Item1
fline = FitLine(Points=debrep.Vertices)
revsrf = Revolution(Curve=item.Item1, Axis=fline, Domain=Domain(0, 6.283185307))
number_slider = Slider(8, range=0..10)
srf = Surface(revsrf)
divide = DivideDomain²(Domain=srf, UCount=Slider(11, range=0..15), VCount=number_slider)
sbox = SurfaceBox(Surface=srf, Domain=divide, Height=Slider(10, range=0..10))
partition = PartitionList(List=sbox, Size=number_slider)  # -> simplify(Chunks)
item_2 = ListItem(List=partition, Index=expr("x-1", number_slider), Wrap=True)
cull_i = CullIndex(List=partition, Indices=expr("x-1", number_slider), Wrap=True)
geo = Geometry(<brep referenced from the Rhino model>)
geo_2 = Geometry(<brep referenced from the Rhino model>)
geo_3 = Geometry(<brep referenced from the Rhino model>)
geo_4 = Geometry(<brep referenced from the Rhino model>)
panel = Panel("""1
0""")
sift = SiftPattern(List=cull_i, SiftPattern=panel)  # -> Output0, Output1
flip = FlipMatrix(Data=sift.Output1)
not = GateNot(A=panel)
join = BrepJoin(Breps=item_2)  # -> Breps, Closed
flip_2 = FlipMatrix(Data=sift.Output0)
sift_2 = SiftPattern(List=flip_2, SiftPattern=panel)  # -> Output0, Output1
sift_3 = SiftPattern(List=flip, SiftPattern=not)  # -> Output0, Output1
mesh = MeshBrep(
    Brep=join.Breps,
    Settings={GridMaxCount=0, GridMinCount=16, JaggedSeams=False, MaxEdgeLength=0, MinEdgeLength=0.0001, MinTolerance=0, Refine=True, RefineAngle=0, RelativeTolerance=0.65, SimplePlanes=True, Tolerance=0})
combine = CombineData(Input0=sift_2.Output0, Input1=sift_3.Output0)  # -> Result, Index

geo1 = Geometry(geo_3)
mesh_2 = MeshBrep(
    Brep=geo1,
    Settings={GridMaxCount=0, GridMinCount=16, JaggedSeams=False, MaxEdgeLength=0, MinEdgeLength=0.0001, MinTolerance=0, Refine=True, RefineAngle=0, RelativeTolerance=0.65, SimplePlanes=True, Tolerance=0})
bbox = BoundingBox(Content=geo1, Plane=PlaneXY(0, 0, 0))  # -> Box, Box_2
morph = BoxMorph(Geometry=mesh_2, Reference=bbox.Box, Target=combine.Result)

combine_2 = CombineData(Input0=sift_2.Output1, Input1=sift_3.Output1)  # -> Result, Index

geo2 = Geometry(geo_4)
mesh_3 = MeshBrep(
    Brep=geo2,
    Settings={GridMaxCount=0, GridMinCount=16, JaggedSeams=False, MaxEdgeLength=0, MinEdgeLength=0.0001, MinTolerance=0, Refine=True, RefineAngle=0, RelativeTolerance=0.65, SimplePlanes=True, Tolerance=0})
bbox_2 = BoundingBox(Content=geo2, Plane=PlaneXY(0, 0, 0))  # -> Box, Box_2
morph_2 = BoxMorph(Geometry=mesh_3, Reference=bbox_2.Box, Target=combine_2.Result)

mjoin = MeshJoin(Meshes=flatten([morph, morph_2, mesh]))
